# Grasshopper definition LCI Rhino-to-RTLCA.gh (Grasshopper 1.0.8)
# plug-ins: Pufferfish, eleFront

# ----
# Liste over anvendte plug-ins:
# - Speckle
# - Ladybug Tools version 1.8.0
# - EleFront version 5.1.8
# LCI script
# Dette LCI script kan anvendes i de tidlige designfaser til at
# trække mængder ud af en volumenstudiemodel.
# Mængderne sendes herfra til Real-Time LCA via Speckle.
# I Real-Time LCA påføres standardmaterialer.
# På sigt bør man kunne auto-mappe modeller ud fra standard konstruktionssæt.
# Import and clean geometry
geometry = Geometry()
clean_tree = CleanTree(RemoveNulls=True, RemoveInvalid=True, RemoveEmpty=False, Tree=geometry)
# Hvis væggene bliver delt op i mange små stumper, betyder det,
# at din geometri ikke er coplanar. Dette skyldes oftest, at der er små punkter,
# der ligger tæt på hinanden.
# Markér din geometri i Rhino og brug kommandoen "ShrinkTrimmedSrf".
# Dette skulle fikse problemet.
panel = Panel(clean_tree)
list_length = ListLength(List=clean_tree)
panel_2 = Panel(list_length)

# ----
# Tilføj etagedæk (in process)
panel_3 = Panel("{0.5,0.5,0}")
deconstruct_brep = DeconstructBrep(Brep=clean_tree)  # -> Faces, Edges, Vertices
evaluate_surface = EvaluateSurface(Surface=reparameterize(deconstruct_brep.Faces), Point=panel_3)  # -> Point, Normal, UDirection, VDirection, Frame
expression = Expression(x=evaluate_surface.Normal, Expression="if(x={0,0,1},True,False)")
expression_2 = Expression(x=evaluate_surface.Normal, Expression="if(x={0,0,-1},True,False)")
dispatch = Dispatch(List=deconstruct_brep.Faces, DispatchPattern=expression)  # -> ListA, ListB
dispatch_2 = Dispatch(List=deconstruct_brep.Faces, DispatchPattern=expression_2)  # -> ListA, ListB
geometry_2 = Geometry(dispatch.ListA)
geometry_3 = Geometry(dispatch_2.ListB)

# ----
# Create HBrooms and solve adjacencies
roomsolid = HBRoomFromSolid(geo=flatten(clean_tree), conditioned=True)  # -> out, rooms; plug-in component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
list_length_2 = ListLength(List=roomsolid.rooms)
number_of_rooms = Panel(list_length_2)
list_of_rooms = Panel(roomsolid.rooms)
panel_4 = Panel(roomsolid.out)
solveadj = HBSolveAdjacency(rooms=flatten(roomsolid.rooms), run=Toggle(True))  # -> out, adj_rooms; plug-in component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
list_of_modified_rooms = Panel(solveadj.adj_rooms)

# ----
# Definér terræn
# Hvis der er kælder i projektet, kan man med fordel tegne et terræn i Rhino og indsætte geometrien her. Derved ved LBT, hvor kælderetagerne starter
geometry_4 = Geometry()
customground = HBCustomGround(rooms=solveadj.adj_rooms, ground=geometry_4)  # -> rooms; plug-in component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

# ----
# Define window size per orientation
wwr_east = Slider(0.3, range=0..1)
wwr_north = Slider(0.4, range=0..1)
wwr_south = Slider(0.2, range=0..1)
wwr_west = Slider(0.3, range=0..1)
facparam = HBFacadeParameters(north=wwr_north, east=wwr_east, south=wwr_south, west=wwr_west)  # -> fac_par; plug-in component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
aperturesbyratio = HBAperturesByRatio(hb_objs=flatten(solveadj.adj_rooms), ratio=facparam)  # -> out, hb_objs; plug-in component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

# ----
# Inspect boundary conditions
hb_face_attributes = HBFaceAttributes({"Display Name": "display_name", "Simulation Name (Identifier)": "identifier", "Boundary Condition": "boundary_condition", "Has Parent": "has_parent", "Parent": "parent", "Azimuth": "azimuth", "Altitude": "altitude", "Area": "area", "Perimeter": "perimeter", "Face Type": "type", "Aperture Is Operable": "is_operable", "Door Is Glass": "is_glass"}, selected="Boundary Condition")
lablefaces = HBLabelFaces(hb_objs=flatten(aperturesbyratio.hb_objs), attribute=hb_face_attributes)  # -> label_text, base_pts, labels, wire_frame; plug-in component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
vizwiref = HBVisualizeWireframe(hb_objs=flatten(aperturesbyratio.hb_objs))  # -> geo; plug-in component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

facesbybc = HBFacesByBC(hb_objs=aperturesbyratio.hb_objs)  # -> outdoors, surface, ground, adiabatic, other; plug-in component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

# ----
# View 3D model
vizbytype = HBVisualizeByType(hb_objs=[facesbybc.surface, facesbybc.outdoors])  # -> walls, interior_walls, roofs, ceilings, exterior_floors, interior_floors, air_walls, apertures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; plug-in component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

vizbytype_2 = HBVisualizeByType(hb_objs=facesbybc.ground)  # -> walls, interior_walls, roofs, ceilings, exterior_floors, interior_floors, air_walls, apertures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; plug-in component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
area = Area(Geometry=vizbytype.walls)  # -> Area, Centroid
area_2 = Area(Geometry=vizbytype.interior_walls)  # -> Area, Centroid
area_3 = Area(Geometry=vizbytype.roofs)  # -> Area, Centroid
area_4 = Area(Geometry=vizbytype.ceilings)  # -> Area, Centroid
area_5 = Area(Geometry=vizbytype.exterior_floors)  # -> Area, Centroid
area_6 = Area(Geometry=vizbytype.interior_floors)  # -> Area, Centroid
area_7 = Area(Geometry=vizbytype.apertures)  # -> Area, Centroid
area_8 = Area(Geometry=vizbytype_2.walls)  # -> Area, Centroid
area_9 = Area(Geometry=vizbytype_2.interior_walls)  # -> Area, Centroid
area_10 = Area(Geometry=vizbytype_2.roofs)  # -> Area, Centroid
area_11 = Area(Geometry=vizbytype_2.ceilings)  # -> Area, Centroid
area_12 = Area(Geometry=vizbytype_2.exterior_floors)  # -> Area, Centroid
ydervæg = Panel(area.Area)
indervæg = Panel(area_2.Area)
tag = Panel(area_3.Area)
loft = Panel(area_4.Area)
terrændæk = Panel(area_5.Area)
etagedæk = Panel(area_6.Area)
vinduer = Panel(area_7.Area)
kælderydervæg = Panel(area_8.Area)
kælderindervæg = Panel(area_9.Area)
kældertag = Panel(area_10.Area)
kælderloft = Panel(area_11.Area)
terrændæk_i_kælder = Panel(area_12.Area)

# ----
# Bake LCA geometry to Rhino
panel_5 = Panel("1_Speckle")
button = Button()
concatenate = Concatenate(ParentLayer=panel_5)
concatenate_2 = Concatenate(ParentLayer=concatenate, FragmentB="::", FragmentA="Ydervæg")
concatenate_3 = Concatenate(ParentLayer=concatenate, FragmentB="::", FragmentA="Indervæg")
concatenate_4 = Concatenate(ParentLayer=concatenate, FragmentB="::", FragmentA="Tag")
concatenate_5 = Concatenate(ParentLayer=concatenate, FragmentB="::", FragmentA="Loft")
concatenate_6 = Concatenate(ParentLayer=concatenate, FragmentB="::", FragmentA="Terrændæk")
concatenate_7 = Concatenate(ParentLayer=concatenate, FragmentB="::", FragmentA="Etagedæk")
concatenate_8 = Concatenate(ParentLayer=concatenate, FragmentB="::", FragmentA="Vindue")
elefront_attributes = EleFrontAttributes(Layer=concatenate_2)
elefront_attributes_2 = EleFrontAttributes(Layer=concatenate_3)
elefront_attributes_3 = EleFrontAttributes(Layer=concatenate_4)
elefront_attributes_4 = EleFrontAttributes(Layer=concatenate_5)
elefront_attributes_5 = EleFrontAttributes(Layer=concatenate_6)
elefront_attributes_6 = EleFrontAttributes(Layer=concatenate_7)
elefront_attributes_7 = EleFrontAttributes(Layer=concatenate_8)
bake_objects = BakeObjects(Geometry=vizbytype.walls, Attributes=elefront_attributes, BakeName="Ydervæg", Bake=button, createGroups=False)  # -> Message, Ghosts
bake_objects_2 = BakeObjects(
    Geometry=vizbytype.interior_walls,
    Attributes=elefront_attributes_2,
    BakeName="Indervæg",
    Bake=button,
    createGroups=False)  # -> Message, Ghosts
bake_objects_3 = BakeObjects(Geometry=vizbytype.roofs, Attributes=elefront_attributes_3, BakeName="Tag", Bake=button, createGroups=False)  # -> Message, Ghosts
bake_objects_4 = BakeObjects(Geometry=vizbytype.ceilings, Attributes=elefront_attributes_4, BakeName="Loft", Bake=button, createGroups=False)  # -> Message, Ghosts
bake_objects_5 = BakeObjects(
    Geometry=vizbytype.exterior_floors,
    Attributes=elefront_attributes_5,
    BakeName="Terrændæk",
    Bake=button,
    createGroups=False)  # -> Message, Ghosts
bake_objects_6 = BakeObjects(
    Geometry=vizbytype.interior_floors,
    Attributes=elefront_attributes_6,
    BakeName="Etagedæk",
    Bake=button,
    createGroups=False)  # -> Message, Ghosts
bake_objects_7 = BakeObjects(Geometry=vizbytype.apertures, Attributes=elefront_attributes_7, BakeName="Vindue", Bake=button, createGroups=False)  # -> Message, Ghosts

panel_6 = Panel("Kælder: Terrændæk i kælder")
concatenate_9 = Concatenate(ParentLayer=concatenate, FragmentB="::", FragmentA="Kælder: Kælderydervæg")
concatenate_10 = Concatenate(ParentLayer=concatenate, FragmentB="::", FragmentA="Kælder: Tag i kælder")
concatenate_11 = Concatenate(ParentLayer=concatenate, FragmentB="::", FragmentA=panel_6)
elefront_attributes_8 = EleFrontAttributes(Layer=concatenate_9)
elefront_attributes_9 = EleFrontAttributes(Layer=concatenate_10)
elefront_attributes_10 = EleFrontAttributes(Layer=concatenate_11)
bake_objects_8 = BakeObjects(
    Geometry=vizbytype_2.walls,
    Attributes=elefront_attributes_8,
    BakeName="Kælder: Kælderydervæg",
    Bake=button,
    createGroups=False)  # -> Message, Ghosts
bake_objects_9 = BakeObjects(
    Geometry=vizbytype_2.roofs,
    Attributes=elefront_attributes_9,
    BakeName="Kælder: Tag i kælder",
    Bake=button,
    createGroups=False)  # -> Message, Ghosts
bake_objects_10 = BakeObjects(
    Geometry=vizbytype_2.exterior_floors,
    Attributes=elefront_attributes_10,
    BakeName=panel_6,
    Bake=button,
    createGroups=False)  # -> Message, Ghosts

model_material = ModelMaterial(Material="Wall_exterior")  # -> Material, Name, Shader
custom_preview = CustomPreview(Material={diffuse=RGB(221, 160, 221), emission=RGB(66, 48, 66), shine=0.5, specular=RGB(255, 255, 255), transparency=0})

# ----
# Data for manual input in Real-Time LCA
# Forbrugsdata er baseret på tal fra værktøjet "CO2 scenarieværktøj til nybyggeri" udarbejdet af Transition for KL og Realdania.
# AI står ikke inden for ægtheden af forbrugsdataen.
# Det bør overvejes, om tallene alternativt skal baseres på VCBK's casebank eller Sweco's LCA database, da Transition
# endnu ikke har opgivet, hvad kilden er til denne data.
# Samlet forbrug
typologi = Panel("""Bolig
Kulturbygning
Daginstitution
Undervisning
Sundhedsbygning
Kontorbygning
Idrætsanlæg""")
image = ImageSampler(
    FilePath="C:\Users\MarkLabrosse\Pictures\Screenshots\Screenshot_18.png",
    Filter="Colour",
    Interpolate=False,
    Umax=1,
    Umin=0,
    Vmax=1,
    Vmin=0,
    Wrap=0)
area_13 = Area(Geometry=[vizbytype.exterior_floors, vizbytype.interior_floors])  # -> Area, Centroid
rumstørrelser = ValueList({"Små": 2.00, "Mellem": 1.00, "Store": 0.60}, selected="Små")
bygningstype = ValueList({"Enfamiliehus": 0, "Etagebolig": 1, "Kontor": 2, "Institution": 3, "Sundhedsbygning": 4, "Idrætsanlæg": 5, "Andet byggeri": 6}, selected="Kontor")
el_kwh_m2_jf_fig_17_39 = Panel("""29
82
57
27
69
65
104""")
mass_addition = MassAddition(Input=area_13.Area)  # -> Result, PartialResults
varme_kwh_m2_jf_fig_17_27 = Panel("""151
139
180
129
155
111
159""")
value_list = ValueList({"Nearest": 0, "Floor": 1, "Ceiling": 2}, selected="Ceiling")
round_to_decimal_place = RoundToDecimalPlace(NumberX=mass_addition.Result, DecimalPlace="1", RoundType=value_list)  # -> Rounded, Difference
expression_3 = Expression(El=el_kwh_m2_jf_fig_17_39, Varme=varme_kwh_m2_jf_fig_17_27, Expression="El/(El+Varme)")
bruttoetageareal_m = Panel(round_to_decimal_place.Rounded)
expression_4 = Expression(Type=bygningstype, SBA=bruttoetageareal_m, Expression="If(Type=0,30+1000/SBA,41+1000/SBA)")
multiplication = Multiplication(A=bruttoetageareal_m, B=rumstørrelser)
panel_7 = Panel(expression_4)
skillevægsareal_m2 = Panel(multiplication)
andel_fra_el = Panel(expression_3)
expression_5 = Expression(x=panel_7, Expression="Format(\"{0:0.00}\",x)")
multiplication_2 = Multiplication(A=panel_7, B=andel_fra_el)
subtraction = Subtraction(A=panel_7, B=multiplication_2)
panel_8 = Panel(expression_5)
elforbrug_kwh_m2_år = Panel(multiplication_2)
varmeforbrug_kwh_m2_år = Panel(subtraction)

# ----
# Create custom material
create_material = CreateMaterial(Diffuse=RGB(255, 105, 180), Specular=RGB(255, 255, 255), Emission=RGB(0, 0, 0), Transparency=0, Shine=0)
render_material = RenderMaterial()  # -> ObjectMaterial, Source, Material
model_material_2 = ModelMaterial()

model_material_3 = ModelMaterial(create_material)

model_material_4 = ModelMaterial(Material=model_material_3, Name="Wall_exterior")  # -> Material, Name, Shader

panel_9 = Panel(model_material_3)
elefront_attributes_11 = EleFrontAttributes(Layer=concatenate_2, MaterialSource=model_material_4.Material, MaterialName=model_material_4.Name)  # -> Attributes, Keys, Values, Name, Layer, ColourSource, DisplayColour, MaterialSource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
